# Grasshopper definition Convert_to_Karamba.gh (Grasshopper 1.0.7)
# plug-ins: HoaryFox, karambaGH, HoaryFox(karambaConnect)

# ↓Set your
# ST-Brigde file path
path = FilePath()

# ----
# Specify the family name of the cross section.
# If not specified,
# the default value for HoaryFox is applied.
#  (HF-Box, HF-H....)
panel = Panel("BCP")
csfamname = SetCroSecFamilyName(Box=panel, H="JIS-H", Circle="Circle", Pipe="Pipe", FB="FB", L="JIS-L", T="T", Other="HF-Other")
panel_2 = Panel(csfamname)

loader = LoadStbData(Path=path)

# ----
# The unit of Karamba is m,
# but the unit of st-bridge data is mm,
# so unit conversion is done here
# to get support points
s2l = StbToLine(Data=loader, Bake=False)  # -> Nodes, Columns, Girders, Posts, Beams, Braces
scale = Scale(Geometry=s2l.Columns, Center=Point(0, 0, 0), Factor=Slider(0.001, range=0..0.001))  # -> Geometry, Transform

end = EndPoints(Curve=scale.Geometry)  # -> Start, End
pdecon = Deconstruct(Point=end.Start)  # -> XComponent, YComponent, ZComponent
smaller = SmallerThan(FirstNumber=pdecon.ZComponent, SecondNumber=Slider(1, range=0..1))  # -> SmallerThan, OrEqualTo
loads = LoadsKaramba3D(Vector=Vector(0, 0, -1), LCase=0, mode="Gravity")

# ---- group: Convert to Karamba Elements
s2k = ConvertToKaramba(Data=loader, FamilyName=csfamname)  # -> ElementBeam, CrossSection

# ----
cull = CullPattern(List=end.Start, CullPattern=smaller.SmallerThan)
supp = SupportKaramba3D(PosInd=cull, menu=[buttons(on, on, on, off, off, off)])
assemble = AssembleModelKaramba3D(Elem=s2k.ElementBeam, Support=supp, Load=loads, CrossSection=s2k.CrossSection, LimitDistance_m=0.005)  # -> Model, Info, Mass_kg, CenterOfGravity
analyze = AnalyzeKaramba3D(Model=assemble.Model)  # -> CalculatedModel, MaximumDisplacement_cm, ResultingForceOfGravity_kN, ElasticEnergy_kNm
modelview = ModelViewKaramba3D(Model=analyze.CalculatedModel, ResultFactors=1, ResultCase=-1)  # -> Model, DeformedMesh, DeformedAxes, DeformedModel
beamview = BeamViewKaramba3D(Model=modelview.Model)  # -> Model, MeshesOfRenderedBeams, DeformedBeamAxes, LegendColors, LegendTags
