# Grasshopper definition ExportSTB.gh (Grasshopper 1.0.7)
# plug-ins: karambaGH, HoaryFox(karambaConnect)

pt = Point(Point(0, 0, 0))
pt_2 = Point(Point(4, 4, 0))
# Create base model to input karamba
rec_2pt = Rectangle2Pt(Plane=PlaneXY(0, 0, 0), PointA=pt, PointB=pt_2, Radius=0)  # -> Rectangle, Length
Z = UnitZ(Factor=Slider(3, range=0..10))
explode = Explode(Curve=rec_2pt.Rectangle, Recursive=True)  # -> Segments, Vertices
move = Move(Geometry=explode.Segments, Motion=Z)  # -> Geometry, Transform
panel = Panel("""1
-1""")
end = EndPoints(Curve=explode.Segments)  # -> Start, End
shift = ShiftList(List=move.Geometry, Shift=panel, Wrap=True)  # -> flatten(List)
Z_2 = UnitZ(Factor=1)
merge = Merge(Data1=end.Start, Data2=end.Start)
end_2 = EndPoints(Curve=shift)  # -> Start, End
line = LineSDL(Start=end.Start, Direction=Z_2, Length=Slider(3, range=0..10))
ln = Line(StartPoint=merge, EndPoint=end_2.Start)

# ---- group: FGirder CrossSection
number_slider = Slider(30, range=0..100)
# In order to identify each cross section in the STB data,
# you need to set a cross section name, such as BD-300x500.
swatch = ColourSwatch(SwatchColor=RGB(138, 138, 138))
# CrossSection Settings
panel_2 = Panel("BD-300x500")
matselect = MaterialSelectionKaramba3D(Color=swatch, menu=[dropdown(3), dropdown(1)])
cross_section = CrossSectionKaramba3D(
    FamilyNameOfCrossSection="DefaultCroSec",
    NameOfCrossSection=panel_2,
    Material=matselect,
    Height_cm=Slider(50, range=0..100),
    UpperFlangeWidth_cm=number_slider,
    LowerFlangeWidth_cm=number_slider,
    mode="Trapezoid")

# ---- group: Girder CrossSection
number_slider_2 = Slider(1.3, range=0..10)
number_slider_3 = Slider(20, range=0..100)
matselect_2 = MaterialSelectionKaramba3D(Color=ColourSwatch(SwatchColor=RGB(255, 48, 48)), menu=[dropdown(1), dropdown(1)])
cross_section_2 = CrossSectionKaramba3D(
    FamilyNameOfCrossSection="DefaultCroSec",
    NameOfCrossSection="H-400x200x8x13",
    Material=matselect_2,
    Height_cm=Slider(40, range=0..100),
    UpperFlangeWidth_cm=number_slider_3,
    LowerFlangeWidth_cm=number_slider_3,
    UpperFlangeThickness_cm=number_slider_2,
    LowerFlangeThickness_cm=number_slider_2,
    WebThickness_cm=0.5,
    FilletRadius_cm=Slider(0.8, range=0..1),
    mode="I")

# ---- group: Brace CrossSection
matselect_3 = MaterialSelectionKaramba3D(Color=ColourSwatch(SwatchColor=RGB(39, 168, 0)), menu=[dropdown(1), dropdown(1)])
cross_section_3 = CrossSectionKaramba3D(
    FamilyNameOfCrossSection="DefaultCroSec",
    NameOfCrossSection="O-76.3x3.2",
    Material=matselect_3,
    Diameter_cm=Slider(7.63, range=0..10),
    WallThickness_cm=Slider(0.32, range=0..1),
    mode="Circular Hollow")

# ---- group: Column CrossSection
number_slider_4 = Slider(1.6, range=0..10)
number_slider_5 = Slider(30, range=0..100)
matselect_4 = MaterialSelectionKaramba3D(Color=ColourSwatch(SwatchColor=RGB(48, 169, 255)), menu=[dropdown(1), dropdown(1)])
cross_section_4 = CrossSectionKaramba3D(
    FamilyNameOfCrossSection="DefaultCroSec",
    NameOfCrossSection="BOX-300x16",
    Material=matselect_4,
    Height_cm=number_slider_5,
    UpperFlangeWidth_cm=number_slider_5,
    LowerFlangeWidth_cm=number_slider_5,
    UpperFlangeThickness_cm=number_slider_4,
    LowerFlangeThickness_cm=number_slider_4,
    SidewallsThickness_cm=number_slider_4,
    FilletRadius_cm=0.6,
    mode="Box")

# ---- group: Column
line_2 = Line(line)

# ---- group: Girder
line_3 = Line(move.Geometry)

# ---- group: FGirder
line_4 = Line(explode.Segments)

# ---- group: Brace
line_5 = Line(ln)

# ----
# If you want  to be treated as brace in STB,
# set it truss element (Bending to false)
panel_3 = Panel("""true
true
true
false""")
graft = GraftTree(Tree=panel_3, IncludeEmptyLists=True, IncludeNullItems=True)

entwine = Entwine(Branch00=cross_section, Branch01=cross_section_4, Branch02=cross_section_2, Branch03=cross_section_3, FlattenInputs=True)
entwine_2 = Entwine(Branch00=line_4, Branch01=line_2, Branch02=line_3, Branch03=line_5, FlattenInputs=True)
panel_4 = Panel("""FGirder
Column
Girder
Brace""")
graft_2 = GraftTree(Tree=panel_4, IncludeEmptyLists=True, IncludeNullItems=True)

# ---- group: Karamba
supp = SupportKaramba3D(PosInd=end.Start, menu=[buttons(on, on, on, off, off, off)])
linetobeam = LineToBeamKaramba3D(Line=entwine_2, Identifier=graft_2, CrossSection=entwine, New=True, Remove=True, LimitDistance_m=0.005, Bending=graft)  # -> flatten(Element), Points, Info
loads = LoadsKaramba3D(Vector=Vector(0, 0, -1), LCase=0, mode="Gravity")
# You don't necessarily have to do the analysis,
# the output of the AssmebleModel component is fine.
assemble = AssembleModelKaramba3D(Elem=linetobeam.Element, Support=supp, Load=loads, LimitDistance_m=0.005)  # -> Model, Info, Mass_kg, CenterOfGravity
analyze = AnalyzeKaramba3D(Model=assemble.Model)  # -> CalculatedModel, MaximumDisplacement_cm, ResultingForceOfGravity_kN, ElasticEnergy_kNm
modelview = ModelViewKaramba3D(Model=analyze.CalculatedModel, ResultFactors=1, ResultCase=-1)  # -> Model, DeformedMesh, DeformedAxes, DeformedModel
beamview = BeamViewKaramba3D(Model=modelview.Model)  # -> Model, MeshesOfRenderedBeams, DeformedBeamAxes, LegendColors, LegendTags

# ----
nodebuilder = NodeBuilder(Model=beamview.Model)

# ----
# The distinction between columns and girder is
# calculated using the angle(radian) inputed in Angle.
# The results are displayed as text in Rhino's viewport.
panel_5 = Panel("pi/4")
frame_by_angle = FrameBuilderByAngle(Model=beamview.Model, Angle=panel_5)  # -> Member, Section

# ---- group: Export Karamba to ST-Bridge / Build Story Data
panel_6 = Panel("""1F
RF""")
panel_7 = Panel("""0
3000""")
panel_8 = Panel("""100
100""")
story = StoryBuilder(Node=nodebuilder, Height=panel_7, Range=panel_8, Name=panel_6)

# ---- group: Export Karamba to ST-Bridge / Build Axis Data
panel_9 = Panel("""100
100
100
100""")
panel_10 = Panel("""X1
X2
Y1
Y2""")
panel_11 = Panel("""0
0
1
1""")
# Create ST-Bridge File using Karamba3D
panel_12 = Panel("""0
4000
0
4000""")
axis = AxisBuilder(Node=nodebuilder, Distance=panel_12, Range=panel_9, Name=panel_10, Direction=panel_11)

# ---- group: Export Karamba to ST-Bridge
# ↓ The panel gives you an overview of
#     the contents of the conversion to STB.
# ↑ Press the button to output stb file
# The default output path is desktop.
button = Button()
panel_13 = Panel(story)
panel_14 = Panel(axis)
export = ExportSTBFile(
    Node=nodebuilder,
    Axis=axis,
    Story=story,
    Member=frame_by_angle.Member,
    Section=frame_by_angle.Section,
    Path="C:\Users\hiroa\Desktop\model.stb",
    Out=button)
panel_15 = Panel(export)
