# Grasshopper definition Filter2LCA.gh (Grasshopper 1.0.7)
# plug-ins: HoaryFox, MaterialSelectionProj

path = FilePath()
loader = LoadSTBFile(Path=path)
s2b = StbToBrep(Data=loader, Bake=Button())  # -> Columns, Girders, Posts, Beams, Braces, Slabs, Walls
mattype = MaterialType(Data=loader)  # -> Columns, Girders, Posts, Beams, Braces, Slabs, Walls
st = Story(Data=loader)  # -> Columns, Girders, Posts, Beams, Braces, Slabs, Walls, StoryName

# ---- group: convert unit mm to m
scale = Scale(Geometry=s2b.Columns, Center=Point(0, 0, 0), Factor="0.001")  # -> Geometry, Transform
scale_2 = Scale(Geometry=s2b.Girders, Center=Point(0, 0, 0), Factor="0.001")  # -> Geometry, Transform
scale_3 = Scale(Geometry=s2b.Beams, Center=Point(0, 0, 0), Factor="0.001")  # -> Geometry, Transform
scale_4 = Scale(Geometry=s2b.Walls, Center=Point(0, 0, 0), Factor="0.001")  # -> Geometry, Transform
scale_5 = Scale(Geometry=s2b.Slabs, Center=Point(0, 0, 0), Factor="0.001")  # -> Geometry, Transform

# ---- group: Filtering by materials
filterbymat = FilterByMaterials(Geometry=scale_5.Geometry, Materials=mattype.Slabs, Stories=st.Slabs)  # -> flatten(RC), flatten(S), SRC, CFT
filterbymat_2 = FilterByMaterials(Geometry=scale.Geometry, Materials=mattype.Columns, Stories=st.Columns)  # -> flatten(RC), flatten(S), SRC, CFT
filterbymat_3 = FilterByMaterials(Geometry=scale_2.Geometry, Materials=mattype.Girders, Stories=st.Girders)  # -> flatten(RC), flatten(S), SRC, CFT
filterbymat_4 = FilterByMaterials(Geometry=scale_3.Geometry, Materials=mattype.Beams, Stories=st.Beams)  # -> flatten(RC), flatten(S), SRC, CFT
filterbymat_5 = FilterByMaterials(Geometry=scale_4.Geometry, Materials=mattype.Walls, Stories=st.Walls)  # -> flatten(RC), flatten(S), SRC, CFT

# ---- group: Create ReportInfo
ec3database = EC3Database(Category="Concrete", SubCategory="Shotcrete", GWP="0.1612", Density="2400", Location="US,CA")
ec3database_2 = EC3Database(Category="Concrete", SubCategory="Shotcrete", GWP="0.1612", Density="2400", Location="US,CA")
ec3database_3 = EC3Database(Category="Concrete", SubCategory="Shotcrete", GWP="0.1612", Density="2400", Location="US,CA")
ec3database_4 = EC3Database(Category="Concrete", SubCategory="Shotcrete", GWP="0.1612", Density="2400", Location="US,CA")
brepimport = BrepImport(Brep=filterbymat_2.RC, Name="Column RC", Thickness=1)
brepimport_2 = BrepImport(Brep=[filterbymat_3.RC, filterbymat_4.RC], Name="Beam RC", Thickness=1)
brepimport_3 = BrepImport(Brep=filterbymat_5.RC, Name="Wall RC", Thickness=1)
brepimport_4 = BrepImport(Brep=filterbymat.RC, Name="Slab RC", Thickness=1)
compileinformation = CompileInformation(GeometryInfo=brepimport, MaterialInfo=ec3database)
compileinformation_2 = CompileInformation(GeometryInfo=brepimport_2, MaterialInfo=ec3database_2)
compileinformation_3 = CompileInformation(GeometryInfo=brepimport_3, MaterialInfo=ec3database_3)
compileinformation_4 = CompileInformation(GeometryInfo=brepimport_4, MaterialInfo=ec3database_4)

# ----
merge = Merge(Data1=compileinformation, Data2=compileinformation_2, Data3=compileinformation_3, Data4=compileinformation_4)
report = Report(ReportInfo=flatten(merge), FileName="Test_00", Export=False)  # -> Report, Name, GWP, Materials, Geometries, TotalGWP
pt = Point(Point(29.65274609, 0, 0))
plotgraph = PlotGraph(
    BasePoint=pt,
    Name=report.Name,
    GWP=report.GWP,
    Materials=report.Materials,
    Height=Slider(28, range=0..100),
    Width=Slider(4, range=0..10),
    Division=10,
    FontSize=Slider(3, range=0..10),
    GWPVisibility=Toggle(True),
    LowBound=ColourSwatch(SwatchColor=RGB(178, 255, 0)),
    HightBound=ColourSwatch(SwatchColor=RGB(255, 0, 0)))  # -> Graph, Line
colorbybrep = ColorByBrep(
    Geometries=report.Geometries,
    GWP=report.GWP,
    LowBound=ColourSwatch(SwatchColor=RGB(178, 255, 0)),
    HightBound=ColourSwatch(SwatchColor=RGB(255, 0, 0)))
