# Grasshopper definition ShowStbModel.gh (Grasshopper 1.0.7)
# plug-ins: HoaryFox

# ↓Set your
# ST-Brigde file path
path = FilePath()

# ---- group: Convert Stb Data to GH
loader = LoadStbData(Path=path)

# ---- group: Show Model as Breps
# If true, Bake into Rhino layered
# by member type and section code.
button = Button()
s2b = StbToBrep(Data=loader, Bake=button)  # -> Columns, Girders, Posts, Beams, Braces, Slabs, Walls

# ---- group: Show Model as Lines
s2l = StbToLine(Data=loader, Bake=Button())  # -> Nodes, Columns, Girders, Posts, Beams, Braces

# ---- group: Show Member Name
beamtag = BeamNameTag(Data=loader, Size="12")
columntag = ColumnNameTag(Data=loader, Size="12")
posttag = PostNameTag(Data=loader, Size="12")
bracetag = BraceNameTag(Data=loader, Size="12")
girdertag = GirderNameTag(Data=loader, Size="12")

# ---- group: Show Section Infomation
beamsec = BeamSectionTag(Data=loader, Size="12")
columsec = ColumnSectionTag(Data=loader, Size="12")
postsec = PostSectionTag(Data=loader, Size="12")
bracesec = BraceSectionTag(Data=loader, Size="12")
girdersec = GirderSectionTag(Data=loader, Size="12")
